# Grasshopper definition 01_analiza_retea_strazi.gh (Grasshopper 1.0.7)
# plug-ins: EleFront, DeCodingSpaces

# ----
# Analiză rețea străzi
# 
# Analiza centralității și accesibilității
# pe o rețea de străzi și vizualizarea
# valorilor de centralitate pe parcele.
# 
# Script dezvoltat în cadrul proiectului
# SCHOLAR ARCHITECT 2024
# Proiect finațat prin CNFIS-FDI-2024-F-0032.
# Autori: Ionuț Anton și Ana Daniela Anton
pipeline = GeometryPipeline(
    GroupByLayer=False,
    GroupByType=False,
    IncludeHidden=True,
    IncludeLocked=True,
    LayerFilter="urbanism::Acces",
    NameFilter="*",
    SublayerFiltering=True,
    TypeFilter=4)
pipeline_2 = GeometryPipeline(
    GroupByLayer=False,
    GroupByType=False,
    IncludeHidden=True,
    IncludeLocked=True,
    LayerFilter="urbanism::Parcele",
    NameFilter="*",
    SublayerFiltering=True,
    TypeFilter=4)
pipeline_3 = GeometryPipeline(
    GroupByLayer=False,
    GroupByType=False,
    IncludeHidden=True,
    IncludeLocked=True,
    LayerFilter="urbanism::Parcele blocuri",
    NameFilter="*",
    SublayerFiltering=True,
    TypeFilter=4)
pipeline_4 = GeometryPipeline(
    GroupByLayer=False,
    GroupByType=False,
    IncludeHidden=True,
    IncludeLocked=True,
    LayerFilter="urbanism::Strazi - axe",
    NameFilter="*",
    SublayerFiltering=True,
    TypeFilter=4)
pipeline_5 = GeometryPipeline(
    GroupByLayer=False,
    GroupByType=False,
    IncludeHidden=True,
    IncludeLocked=True,
    LayerFilter="analiza::contur limita analiza",
    NameFilter="*",
    SublayerFiltering=True,
    TypeFilter=4)

# ---- group: Click aici pentru bake in rhino
button = Button()

# ----
parcele_blocuri = Curve(pipeline_3)
limita_analiza = Curve(pipeline_5)
acces = Curve(pipeline)
parcele = Curve(pipeline_2)
strazi = Curve(pipeline_4)
merge = Merge(Data1=parcele, Data2=parcele_blocuri)
network2segments = NetworkToSegments(NetworkGeometry=strazi, ConvertCurves=True, ConversionAngle=0.2, Split=True)
crv = Curve(network2segments)

# ---- group: parcele
crv_2 = Curve(merge)

# ----
boundary = BoundarySurfaces(Edges=graft(crv_2))  # -> flatten(Surfaces)
srf = Surface(boundary)
wires = BrepWireframe(Brep=srf, Density=-1)
join = JoinCurves(Curves=wires, Preserve=False)  # -> flatten(Curves)
area = Area(Geometry=join)  # -> Area, Centroid
building_centroid = Point(area.Centroid)

end = EndPoints(Curve=acces)  # -> Start, End
incurve = PointInCurve(Point=end.Start, Curve=graft(join))  # -> Relationship, Point
incurve_2 = PointInCurve(Point=end.End, Curve=graft(join))  # -> Relationship, Point
equals = Equality(FirstNumber=incurve_2.Relationship, SecondNumber="0")  # -> Equality, Inequality
equals_2 = Equality(FirstNumber=incurve.Relationship, SecondNumber="0")  # -> Equality, Inequality
not = GateNot(A=equals_2.Equality)
not_2 = GateNot(A=equals.Equality)
cull = CullPattern(List=end.Start, CullPattern=not_2)
cull_2 = CullPattern(List=end.End, CullPattern=not)
merge_2 = Merge(Data1=simplify(cull_2), Data2=simplify(cull))
null = NullItem(Item=merge_2)  # -> NullFlags, InvalidFlags, Description
weave = Weave(Pattern=null.NullFlags, Stream0=merge_2, Stream1=graft(building_centroid), NullGaps=False)  # -> flatten(Weave)

# ---- group: Shortest Paths / Coefficients for combining Angular Metric and Custom Weight
number_slider = Slider(0.5, range=0..1)
number_slider_2 = Slider(0.5, range=0..1)

# ---- group: Shortest Paths
line = Line(crv)
_1_process_geometry = _1ProcessGeometry(Path=line, SegmentLength=10000, GenerateNewVisibilityPaths=False)  # -> B, Sg, DblSg, Ids
dblsg = Line(_1_process_geometry.DblSg)
sg = Line(_1_process_geometry.Sg)
ids = Integer(_1_process_geometry.Ids)
_2_build_graph = _2BuildGraph(
    Object=_1_process_geometry.B,
    LengthCoefficient=number_slider,
    AngularCoefficient=number_slider_2,
    AdditionalEdgeWeightCoefficient=0,
    CalculateDegree=False,
    CalculateInverseGraph=False,
    CopyObject=True)  # -> Object, GraphGeometry, Text, ReferencedEdges, DegreeCentrality
_3_shortest_path_floyd_warshal = _3ShortestFloydWarshal(Object=_2_build_graph.Object, CopyObject=True, IncludeMaA=False, UseGPU=False)

# ---- group: Sort parcela to the closest street segment
crv_cp = CurveClosestPoint(Point=simplify(graft(weave)), Curve=simplify(sg))  # -> Point, Parameter, Distance
lng = ListLength(List=sg)
series = Series(Start=0, Step=1, Count=lng)
sort = SortList(Keys=crv_cp.Distance, ValuesA=series)  # -> Keys, ValuesA
item = ListItem(List=sort.ValuesA, Index=0, Wrap=True)  # -> simplify(Item)

# ----
item_2 = ListItem(List=crv_cp.Point, Index=graft(item), Wrap=True)
ln = Line(StartPoint=graft(weave), EndPoint=item_2)

# ----
# select BC and Ln // needs to be done always after loading the definition //
_4_f_w_get_paths = _4FWGetPaths(
    Object=_3_shortest_path_floyd_warshal,
    Origins=sg,
    Destinations=sg,
    PairwiseShortestPaths=False,
    Radius=0,
    CopyObject=True,
    MaskInputString="00000010",
    PathInfoForPoints=False,
    UseGPU=False)  # -> BetweennessCentrality, ClosenessCentrality, Gravity, BetweennessCentralityWeighted, ClosenessCentralityWeighted, SupplementaryGeometry, PathsInformation

data = Data(_4_f_w_get_paths.ClosenessCentrality)
number_slider_3 = Slider(2, range=0..10)
offset = OffsetCurve(Curve=sg, Distance=expr("-x", number_slider_3), Corners=1)
offset_2 = OffsetCurve(Curve=sg, Distance=number_slider_3, Corners=1)
bnd = Bounds(Numbers=data)
merge_3 = Merge(Data1=offset_2, Data2=offset)
dedomain = DeconstructDomain(Domain=bnd)  # -> Start, End
loft = Loft(Curves=merge_3, Options={Adjust=False, Closed=False, LoftEnds=0, LoftSimp=0, LoftType=0, Rebuild=10, Refit=0.01})  # -> flatten(Loft)
gradient = Gradient(
    LowerLimit=dedomain.Start,
    UpperLimit=dedomain.End,
    Parameter=data,
    stops=[0: RGB(0, 128, 0), 0.5: RGB(255, 255, 0), 1: RGB(255, 0, 0)])
wires_2 = BrepWireframe(Brep=loft, Density=-1)
join_2 = JoinCurves(Curves=wires_2, Preserve=False)
hatch = DefineHatch(Curve=join_2, Pattern="Solid", Rotation=0, Scale=1)  # -> flatten(Hatch)

# ---- group: Visualize the plots based on the network centrality
item_3 = ListItem(List=_4_f_w_get_paths.ClosenessCentrality, Index=item, Wrap=True)  # -> flatten(Item)
num = Number(item_3)
bnd_2 = Bounds(Numbers=num)
dedomain_2 = DeconstructDomain(Domain=bnd_2)  # -> Start, End
gradient_2 = Gradient(
    LowerLimit=dedomain_2.Start,
    UpperLimit=dedomain_2.End,
    Parameter=num,
    stops=[0: RGB(0, 128, 0), 0.5: RGB(255, 255, 0), 1: RGB(255, 0, 0)])
hatch_2 = DefineHatch(Curve=graft(srf), Pattern="Solid", Rotation=0, Scale=1)  # -> flatten(Hatch)

# ----
time = Time("now")
format = Format(Format="{0:yyyy-MM-dd-HH-mm-ss}", Culture=127, Data0=time)
concat = Concatenate(FragmentA="analiza_out::retea_centralitate_accesibilitate::", FragmentB=format)
concat_2 = Concatenate(FragmentA=concat, FragmentB="::parcele")
concat_3 = Concatenate(FragmentA=concat, FragmentB="::strazi")
layer = DefineLayer(Name=concat_2)
layer_2 = DefineLayer(Name=concat_3)

short = ShortestList(ListA=hatch_2, ListB=gradient_2, ListC=num, TrimMode=2)  # -> ListA, ListB, ListC

panel = Panel("centralitate_accesibilitate")
lng_2 = ListLength(List=short.ListB)
dup = DuplicateData(Data=panel, Number=lng_2, Order=True)
attributes = DefineObjectAttributes(UserKeys=dup, UserValues=short.ListC, Layer=layer, Color=short.ListB)
attributes_2 = DefineObjectAttributes(Layer=layer_2, Color=gradient)

bbox = BoundingBox(Content=limita_analiza, Plane=PlaneXY(0, 0, 0))  # -> Box, Box_2
evalsrf = EvaluateSurface(Surface=reparameterize(bbox.Box), Point="{1,0,0}")  # -> Point, Normal, UDirection, VDirection, Frame
Y = UnitY(Factor="-100")
move = Move(Geometry=evalsrf.Point, Motion=Y)  # -> Geometry, Transform
list = ValueList({"Default", "Legenda"}, selected="Legenda")
range = Range(Domain=bnd_2, Steps=expr("x-1", "5"))
range_2 = Range(Domain=Domain(0, 1), Steps=expr("x-1", "5"))
sqgrid = Square(Plane=move.Geometry, Size=Slider(50, range=0..100), ExtentX="5", ExtentY="1")  # -> Cells, Points
text = DefineTextObject(Text=panel, Plane=evalsrf.Point, DimensionStyle=list, OutputType="Text")
swatch = ColourSwatch(SwatchColor=RGB(0, 0, 0))
hatch_3 = DefineHatch(Curve=flatten(sqgrid.Cells), Pattern="Solid", Rotation=0, Scale=1)
area_2 = Area(Geometry=flatten(sqgrid.Cells))  # -> Area, Centroid
gradient_3 = Gradient(LowerLimit=0, UpperLimit=1, Parameter=range_2, stops=[0: RGB(0, 128, 0), 0.5: RGB(255, 255, 0), 1: RGB(255, 0, 0)])
concat_4 = Concatenate(FragmentA=concat, FragmentB="::legenda")
Y_2 = UnitY(Factor="-30")
expression = Expression(x=range, y=Slider(2, range=0..10), Expression="Round(x,y)")
layer_3 = DefineLayer(Name=concat_4)
move_2 = Move(Geometry=area_2.Centroid, Motion=Y_2)  # -> Geometry, Transform
text_2 = DefineTextObject(Text=expression, Plane=move_2.Geometry, DimensionStyle="Legenda_numere", OutputType="Text")
lng_3 = ListLength(List=text_2)
attributes_3 = DefineObjectAttributes(Layer=layer_3, Color=gradient_3)
attributes_4 = DefineObjectAttributes(Layer=layer_3, Color=swatch)
dup_2 = DuplicateData(Data=swatch, Number=lng_3, Order=True)
attributes_5 = DefineObjectAttributes(Layer=layer_3, Color=dup_2)
merge_4 = Merge(Data1=flatten(short.ListA), Data2=flatten(hatch), Data3=flatten(text), Data4=flatten(hatch_3), Data5=flatten(text_2))
merge_5 = Merge(
    Data1=flatten(attributes),
    Data2=flatten(attributes_2),
    Data3=flatten(attributes_4),
    Data4=flatten(attributes_3),
    Data5=flatten(attributes_5))

deatt = DeconstructAttributes(ReferencedGeometryOrAttributes=merge_5)  # -> Keys, Values, Name, Layer, Color
bake = BakeObjects(Geometry=merge_4, Attributes=merge_5, Bake=button)
material = CreateMaterial(Diffuse=deatt.Color, Specular=RGB(255, 255, 255), Emission=RGB(0, 0, 0), Transparency=0, Shine=0)
preview = CustomPreview(Geometry=merge_4, Shader=flatten(material))
