# Grasshopper definition 07_analiza_denisitate_CUT.gh (Grasshopper 1.0.7)
# plug-ins: EleFront

pipeline = GeometryPipeline(
    GroupByLayer=False,
    GroupByType=False,
    IncludeHidden=True,
    IncludeLocked=True,
    LayerFilter="analiza::contur limita analiza",
    NameFilter="*",
    SublayerFiltering=True,
    TypeFilter=4)
pipeline_2 = GeometryPipeline(
    GroupByLayer=False,
    GroupByType=False,
    IncludeHidden=True,
    IncludeLocked=True,
    LayerFilter="urbanism::Parcele blocuri",
    NameFilter="*",
    SublayerFiltering=True,
    TypeFilter=4)
# Analiză densitate - CUT
# 
# Analiza denistate urbană -
# coeficient de utilizare teren.
# 
# Script dezvoltat în cadrul proiectului
# SCHOLAR ARCHITECT 2024
# Proiect finațat prin CNFIS-FDI-2024-F-0032.
# Autori: Ionuț Anton și Ana Daniela Anton
pipeline_3 = GeometryPipeline(
    GroupByLayer=False,
    GroupByType=False,
    IncludeHidden=True,
    IncludeLocked=True,
    LayerFilter="propunere::Constructii",
    NameFilter="*",
    SublayerFiltering=True,
    TypeFilter=4)
pipeline_4 = GeometryPipeline(
    GroupByLayer=False,
    GroupByType=False,
    IncludeHidden=True,
    IncludeLocked=True,
    LayerFilter="urbanism::Constructii",
    NameFilter="*",
    SublayerFiltering=True,
    TypeFilter=4)
pipeline_5 = GeometryPipeline(
    GroupByLayer=False,
    GroupByType=False,
    IncludeHidden=True,
    IncludeLocked=True,
    LayerFilter="urbanism::Parcele",
    NameFilter="*",
    SublayerFiltering=True,
    TypeFilter=4)

# ---- group: Click aici pentru bake in rhino
button = Button()

# ----
constructii = Curve(pipeline_4)
propunere = Curve(pipeline_3)
parcele = Curve(pipeline_5)
parcele_blocuri = Curve(pipeline_2)
crv = Curve(pipeline)
merge = Merge(Data1=flatten(propunere), Data2=flatten(constructii))
merge_2 = Merge(Data1=flatten(parcele), Data2=flatten(parcele_blocuri))  # -> graft(Result)
list = ValueList({"inaltime(m)"}, selected="inaltime(m)")
getuv = GetUserValue(Geometry=merge, Key=list)
area = Area(Geometry=merge)  # -> Area, Centroid
division = Division(A=getuv, B="3")
incurve = PointInCurve(Point=area.Centroid, Curve=graft(merge_2))  # -> Relationship, Point
area_2 = Area(Geometry=graft(merge_2))  # -> Area, Centroid
int = Integer(division)
equals = Equality(FirstNumber=incurve.Relationship, SecondNumber="2")  # -> Equality, Inequality
multiplication = Multiplication(A=int, B=area.Area)
adc = Data(multiplication)
cull = CullPattern(List=adc, CullPattern=equals.Equality)
ma = MassAddition(Input=cull)  # -> Result, PartialResults
nullrep = ReplaceNulls(Items=ma.Result, Replacements="0")  # -> Items, Count
division_2 = Division(A=nullrep.Items, B=area_2.Area)
expression = Expression(x=division_2, y=Slider(2, range=0..10), Expression="Round(x,y)")
bnd = Bounds(Numbers=flatten(expression))
dedomain = DeconstructDomain(Domain=bnd)  # -> Start, End
gradient = Gradient(
    LowerLimit=dedomain.Start,
    UpperLimit=dedomain.End,
    Parameter=expression,
    stops=[0: RGB(176, 202, 232), 1: RGB(0, 68, 255)])
hatch = DefineHatch(Curve=merge_2, Pattern="Solid", Rotation=0, Scale=1)  # -> graft(Hatch)

time = Time("now")
format = Format(Format="{0:yyyy-MM-dd-HH-mm-ss}", Culture=127, Data0=time)
concat = Concatenate(FragmentA="analiza_out::denistate_CUT::", FragmentB=format)
concat_2 = Concatenate(FragmentA=concat, FragmentB="::analiza")
layer = DefineLayer(Name=concat_2)

bbox = BoundingBox(Content=crv, Plane=PlaneXY(0, 0, 0))  # -> Box, Box_2
evalsrf = EvaluateSurface(Surface=reparameterize(bbox.Box), Point="{1,0,0}")  # -> Point, Normal, UDirection, VDirection, Frame
Y = UnitY(Factor="-100")
move = Move(Geometry=evalsrf.Point, Motion=Y)  # -> Geometry, Transform
list_2 = ValueList({"Default", "Legenda"}, selected="Legenda")
range = Range(Domain=bnd, Steps=expr("x-1", "5"))
range_2 = Range(Domain=Domain(0, 1), Steps=expr("x-1", "5"))
sqgrid = Square(Plane=move.Geometry, Size=Slider(50, range=0..100), ExtentX="5", ExtentY="1")  # -> Cells, Points
text = DefineTextObject(Text="densitate_CUT", Plane=evalsrf.Point, DimensionStyle=list_2, OutputType="Text")
hatch_2 = DefineHatch(Curve=flatten(sqgrid.Cells), Pattern="Solid", Rotation=0, Scale=1)
gradient_2 = Gradient(LowerLimit=0, UpperLimit=1, Parameter=range_2, stops=[0: RGB(176, 202, 232), 1: RGB(0, 68, 255)])
area_3 = Area(Geometry=flatten(sqgrid.Cells))  # -> Area, Centroid
swatch = ColourSwatch(SwatchColor=RGB(0, 0, 0))
Y_2 = UnitY(Factor="-30")
concat_3 = Concatenate(FragmentA=concat, FragmentB="::legenda")
move_2 = Move(Geometry=area_3.Centroid, Motion=Y_2)  # -> Geometry, Transform
layer_2 = DefineLayer(Name=concat_3)
attributes = DefineObjectAttributes(Layer=layer_2, Color=gradient_2)
attributes_2 = DefineObjectAttributes(Layer=layer_2, Color=swatch)

lng = ListLength(List=expression)
dup = DuplicateData(Data="densitate_CUT", Number=lng, Order=True)
attributes_3 = DefineObjectAttributes(UserKeys=dup, UserValues=expression, Layer=layer, Color=gradient)

expression_2 = Expression(x=range, y=Slider(2, range=0..10), Expression="Round(x,y)")

text_2 = DefineTextObject(Text=expression_2, Plane=move_2.Geometry, DimensionStyle="Legenda_numere", OutputType="Text")
lng_2 = ListLength(List=text_2)
dup_2 = DuplicateData(Data=swatch, Number=lng_2, Order=True)
attributes_4 = DefineObjectAttributes(Layer=layer_2, Color=dup_2)
merge_3 = Merge(Data1=flatten(attributes_3), Data2=flatten(attributes_2), Data3=flatten(attributes_4), Data4=flatten(attributes))
merge_4 = Merge(Data1=flatten(hatch), Data2=flatten(text), Data3=flatten(text_2), Data4=flatten(hatch_2))

deatt = DeconstructAttributes(ReferencedGeometryOrAttributes=merge_3)  # -> Keys, Values, Name, Layer, Color
bake = BakeObjects(Geometry=merge_4, Attributes=merge_3, Bake=button)
material = CreateMaterial(Diffuse=deatt.Color, Specular=RGB(255, 255, 255), Emission=RGB(0, 0, 0), Transparency=0, Shine=0)
preview = CustomPreview(Geometry=merge_4, Shader=flatten(material))
