# Grasshopper definition 09_analiza_radiatie_solara.gh (Grasshopper 1.0.7)
# plug-ins: EleFront

# ---- group: marime grid analiza (recomandat 5)
number_slider = Slider(10, range=0..10)

# ----
pipeline = GeometryPipeline(
    GroupByLayer=False,
    GroupByType=False,
    IncludeHidden=True,
    IncludeLocked=True,
    LayerFilter="analiza::contur limita analiza",
    NameFilter="*",
    SublayerFiltering=True,
    TypeFilter=4)
pipeline_2 = GeometryPipeline(
    GroupByLayer=False,
    GroupByType=False,
    IncludeHidden=True,
    IncludeLocked=True,
    LayerFilter="propunere::Constructii",
    NameFilter="*",
    SublayerFiltering=True,
    TypeFilter=4)
pipeline_3 = GeometryPipeline(
    GroupByLayer=False,
    GroupByType=False,
    IncludeHidden=True,
    IncludeLocked=True,
    LayerFilter="urbanism::Constructii",
    NameFilter="*",
    SublayerFiltering=True,
    TypeFilter=4)

# ---- group: Click aici pentru bake in rhino
button = Button()

# ----
# Analiză radiatie solara
# 
# Analiza radiatie solara pe planul orizontal
# de-a lungul unui intreg an pentru Bucuresti.
# 
# Script dezvoltat în cadrul proiectului
# SCHOLAR ARCHITECT 2024
# Proiect finațat prin CNFIS-FDI-2024-F-0032.
# Autori: Ionuț Anton și Ana Daniela Anton
# Import Weather Data
python = GhPythonScript()  # -> out, a, b
# ---------- python: Python ----------
__author__ = "ionut"
__version__ = "2024.10.09"

import rhinoscriptsyntax as rs
import os

a = ghdoc.Path
# Get the directory of the given file path
folder_path = os.path.dirname(a)

# Define the subfolder and file to append
subfolder_file = r'installs\ROU_Bucharest.154200_IWEC\ROU_Bucharest.154200_IWEC.epw'

# Create the new file path by joining the folder path and subfolder_file
b = os.path.join(folder_path, subfolder_file)
# ---------- end python ----------
importepw = LBImportEPW(epw_file=python.b)  # -> location, dry_bulb_temperature, dew_point_temperature, relative_humidity, wind_speed, wind_direction, direct_normal_rad, diffuse_horizontal_rad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; plug-in component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

# ----
# Annual Radiation
panel = Panel("0")
skymatrix = LBCumulativeSkyMatrix(
    north=panel,
    location=importepw.location,
    direct_rad=importepw.direct_normal_rad,
    diffuse_rad=importepw.diffuse_horizontal_rad)  # -> report, sky_mtx; plug-in component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

# ---- group: Prima data click aici ca sa ruleze analiza
toggle = BooleanToggle(True)

# ----
merge = Merge(Data1=pipeline_2, Data2=pipeline_3)
list = ValueList({"inaltime(m)"}, selected="inaltime(m)")
getuv = GetUserValue(Geometry=merge, Key=list)
Z = UnitZ(Factor=getuv)
extr = Extrude(Base=merge, Direction=Z)
boundary = BoundarySurfaces(Edges=pipeline)
clean = CleanTree(RemoveNulls=True, RemoveInvalid=True, RemoveEmpty=False, Tree=extr)
cap = CapHoles(Brep=clean)
panel_2 = Panel(number_slider)
lng = ListLength(List=cap)
dup = DuplicateData(Data=ColourSwatch(SwatchColor=RGB(46, 46, 46)), Number=lng, Order=True)

# ----
# Run Radiation Study
geo = Geometry(boundary)
geo_2 = Geometry(cap)
incidentradiation = LBIncidentRadiation(
    sky_mtx=skymatrix.sky_mtx,
    geometry=flatten(geo),
    context=flatten(geo_2),
    grid_size=panel_2,
    offset_dist="0.1",
    run=toggle)  # -> report, points, results, total, mesh, legend, title, int_mtx; plug-in component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

faceb = FaceBoundaries(Mesh=incidentradiation.mesh)  # -> graft(Boundaries)
bnd = Bounds(Numbers=flatten(incidentradiation.results))
dedomain = DeconstructDomain(Domain=bnd)  # -> Start, End
hatch = DefineHatch(Curve=faceb, Pattern="Solid", Rotation=0, Scale=1)  # -> flatten(Hatch)
gradient = Gradient(
    LowerLimit=dedomain.Start,
    UpperLimit=dedomain.End,
    Parameter=incidentradiation.results,
    stops=[0: RGB(25, 0, 255), 0.5: RGB(255, 0, 0), 1: RGB(255, 255, 0)])

bbox = BoundingBox(Content=pipeline, Plane=PlaneXY(0, 0, 0))  # -> Box, Box_2
evalsrf = EvaluateSurface(Surface=reparameterize(bbox.Box), Point="{1,0,0}")  # -> Point, Normal, UDirection, VDirection, Frame
Y = UnitY(Factor="-100")
move = Move(Geometry=evalsrf.Point, Motion=Y)  # -> Geometry, Transform
list_2 = ValueList({"Default", "Legenda"}, selected="Legenda")
range = Range(Domain=bnd, Steps=expr("x-1", "5"))
range_2 = Range(Domain=Domain(0, 1), Steps=expr("x-1", "5"))
sqgrid = Square(Plane=move.Geometry, Size=Slider(50, range=0..100), ExtentX="5", ExtentY="1")  # -> Cells, Points
text = DefineTextObject(Text="radiatie_solara", Plane=evalsrf.Point, DimensionStyle=list_2, OutputType="Text")
hatch_2 = DefineHatch(Curve=flatten(sqgrid.Cells), Pattern="Solid", Rotation=0, Scale=1)
area = Area(Geometry=flatten(sqgrid.Cells))  # -> Area, Centroid
swatch = ColourSwatch(SwatchColor=RGB(0, 0, 0))
Y_2 = UnitY(Factor="-30")
expression = Expression(x=range, y=Slider(0, range=0..10), Expression="Round(x,y)")
move_2 = Move(Geometry=area.Centroid, Motion=Y_2)  # -> Geometry, Transform
text_2 = DefineTextObject(Text=expression, Plane=move_2.Geometry, DimensionStyle="Legenda_numere", OutputType="Text")
lng_2 = ListLength(List=text_2)
dup_2 = DuplicateData(Data=swatch, Number=lng_2, Order=True)

gradient_2 = Gradient(LowerLimit=0, UpperLimit=1, Parameter=range_2, stops=[0: RGB(25, 0, 255), 0.5: RGB(255, 0, 0), 1: RGB(255, 255, 0)])

time = Time("now")
format = Format(Format="{0:yyyy-MM-dd-HH-mm-ss}", Culture=127, Data0=time)
concat = Concatenate(FragmentA="analiza_out::radiatie_solara::", FragmentB=format)
concat_2 = Concatenate(FragmentA=concat, FragmentB="::cladiri_3d")

lng_3 = ListLength(List=incidentradiation.results)
dup_3 = DuplicateData(Data="radiatie_solara", Number=lng_3, Order=True)
concat_3 = Concatenate(FragmentA=concat, FragmentB="::analiza")
layer = DefineLayer(Name=concat_2)
layer_2 = DefineLayer(Name=concat)
attributes = DefineObjectAttributes(Layer=layer, Color=dup)
merge_2 = Merge(Data1=flatten(hatch), Data2=flatten(cap))

layer_3 = DefineLayer(Name=concat_3)

attributes_2 = DefineObjectAttributes(UserKeys=dup_3, UserValues=incidentradiation.results, Layer=layer_3, Color=gradient)
merge_3 = Merge(Data1=flatten(attributes_2), Data2=flatten(attributes))

concat_4 = Concatenate(FragmentA=concat, FragmentB="::legenda")
layer_4 = DefineLayer(Name=concat_4)
attributes_3 = DefineObjectAttributes(Layer=layer_4, Color=gradient_2)
attributes_4 = DefineObjectAttributes(Layer=layer_4, Color=dup_2)
attributes_5 = DefineObjectAttributes(Layer=layer_4, Color=swatch)
merge_4 = Merge(Data1=flatten(merge_3), Data2=flatten(attributes_5), Data3=flatten(attributes_4), Data4=flatten(attributes_3))
merge_5 = Merge(Data1=flatten(merge_2), Data2=flatten(text), Data3=flatten(text_2), Data4=flatten(hatch_2))

deatt = DeconstructAttributes(ReferencedGeometryOrAttributes=merge_4)  # -> Keys, Values, Name, Layer, Color
bake = BakeObjects(Geometry=merge_5, Attributes=merge_4, Bake=button)
material = CreateMaterial(Diffuse=deatt.Color, Specular=RGB(255, 255, 255), Emission=RGB(0, 0, 0), Transparency=0, Shine=0)
preview = CustomPreview(Geometry=merge_5, Shader=flatten(material))
