# Grasshopper definition 01_analiza_retea_strazi_2025.gh (Grasshopper 1.0.8)
# plug-ins: DeCodingSpaces, eleFront

# ----
# Analiză rețea străzi
# 
# Analiza centralității și accesibilității
# pe o rețea de străzi și vizualizarea
# valorilor de centralitate pe parcele.
# 
# Script dezvoltat în cadrul proiectului
# SCHOLAR ARCHITECT 2024
# Proiect finațat prin CNFIS-FDI-2024-F-0032.
# Autori: Ionuț Anton și Ana Daniela Anton
pipeline = GeometryPipeline(
    GroupByLayer=False,
    GroupByType=False,
    IncludeHidden=True,
    IncludeLocked=True,
    LayerFilter="urbanism::Acces",
    NameFilter="*",
    SublayerFiltering=True,
    TypeFilter=4)
pipeline_2 = GeometryPipeline(
    GroupByLayer=False,
    GroupByType=False,
    IncludeHidden=True,
    IncludeLocked=True,
    LayerFilter="urbanism::Parcele",
    NameFilter="*",
    SublayerFiltering=True,
    TypeFilter=4)
pipeline_3 = GeometryPipeline(
    GroupByLayer=False,
    GroupByType=False,
    IncludeHidden=True,
    IncludeLocked=True,
    LayerFilter="urbanism::Parcele blocuri",
    NameFilter="*",
    SublayerFiltering=True,
    TypeFilter=4)
pipeline_4 = GeometryPipeline(
    GroupByLayer=False,
    GroupByType=False,
    IncludeHidden=True,
    IncludeLocked=True,
    LayerFilter="urbanism::Strazi - axe",
    NameFilter="*",
    SublayerFiltering=True,
    TypeFilter=4)
pipeline_5 = GeometryPipeline(
    GroupByLayer=False,
    GroupByType=False,
    IncludeHidden=True,
    IncludeLocked=True,
    LayerFilter="analiza::contur limita analiza",
    NameFilter="*",
    SublayerFiltering=True,
    TypeFilter=4)

# ---- group: Click aici pentru bake in rhino
button = Button()

# ----
parcele_blocuri = Curve(pipeline_3)
limita_analiza = Curve(pipeline_5)
acces = Curve(pipeline)
parcele = Curve(pipeline_2)
strazi = Curve(pipeline_4)
merge = Merge(Data1=parcele, Data2=parcele_blocuri)
network2segments = NetworkToSegments(NetworkGeometry=strazi, ConvertCurves=True, ConversionAngle=0.2, Split=True)
crv = Curve(network2segments)

# ---- group: parcele
crv_2 = Curve(merge)

# ---- group: Shortest Paths / Coefficients for combining Angular Metric and Custom Weight
number_slider = Slider(0.5, range=0..1)
number_slider_2 = Slider(0.5, range=0..1)

# ---- group: Shortest Paths
line = Line(crv)
_1_process_geometry = _1ProcessGeometry(Path=line, SegmentLength=10000, GenerateNewVisibilityPaths=False)  # -> B, Sg, DblSg, Ids
sg = Line(_1_process_geometry.Sg)
dblsg = Line(_1_process_geometry.DblSg)
ids = Integer(_1_process_geometry.Ids)
_2_build_graph = _2BuildGraph(
    Object=_1_process_geometry.B,
    LengthCoefficient=number_slider,
    AngularCoefficient=number_slider_2,
    AdditionalEdgeWeightCoefficient=0,
    CalculateDegree=False,
    CalculateInverseGraph=False,
    CopyObject=True)  # -> Object, GraphGeometry, Text, ReferencedEdges, DegreeCentrality
_3_shortest_path_floyd_warshal = _3ShortestFloydWarshal(Object=_2_build_graph.Object, CopyObject=True, IncludeMaA=False, UseGPU=False)

# ----
# select BC and Ln // needs to be done always after loading the definition //
_4_f_w_get_paths = _4FWGetPaths(
    Object=_3_shortest_path_floyd_warshal,
    Origins=sg,
    Destinations=sg,
    PairwiseShortestPaths=False,
    Radius=0,
    CopyObject=True,
    MaskInputString="00000010",
    PathInfoForPoints=False,
    UseGPU=False)  # -> BetweennessCentrality, ClosenessCentrality, Gravity, BetweennessCentralityWeighted, ClosenessCentralityWeighted, SupplementaryGeometry, PathsInformation

data = Data(_4_f_w_get_paths.ClosenessCentrality)
number_slider_3 = Slider(2, range=0..10)
offset = OffsetCurve(Curve=sg, Distance=expr("-x", number_slider_3), Corners=1)
offset_2 = OffsetCurve(Curve=sg, Distance=number_slider_3, Corners=1)
bnd = Bounds(Numbers=data)
merge_2 = Merge(Data1=offset_2, Data2=offset)
dedomain = DeconstructDomain(Domain=bnd)  # -> Start, End
loft = Loft(Curves=merge_2, Options={Adjust=False, Closed=False, LoftEnds=0, LoftSimp=0, LoftType=0, Rebuild=10, Refit=0.01})  # -> flatten(Loft)
gradient = Gradient(
    LowerLimit=dedomain.Start,
    UpperLimit=dedomain.End,
    Parameter=data,
    stops=[0: RGB(0, 128, 0), 0.5: RGB(255, 255, 0), 1: RGB(255, 0, 0)])
wires = BrepWireframe(Brep=loft, Density=-1)
join = JoinCurves(Curves=wires, Preserve=False)

hatch = DefineHatch(Curve=flatten(join), Pattern="Solid", Rotation=0, Scale=1)

trigger = Trigger(Interval=60000, TimerInterval=60000, Target=time)
time = Time("now")
format = Format(Format="{0:yyyy-MM-dd-HH-mm-ss}", Culture=127, Data0=time)
concat = Concatenate(FragmentA="analiza_out::retea_centralitate_accesibilitate::", FragmentB=format)
concat_2 = Concatenate(FragmentA=concat, FragmentB="::parcele")
concat_3 = Concatenate(FragmentA=concat, FragmentB="::strazi")

list = ValueList({"Layer", "Material", "Object", "Parent"}, selected="Object")
list_2 = ValueList({"Layer", "Material", "Object", "Parent"}, selected="Object")
ef_layer = EleFrontLayer(Layer=concat_2, fullpath=True)
ef_layer_2 = EleFrontLayer(Layer=concat_3, fullpath=True)
attributes = EleFrontAttributes(Layer=ef_layer_2, ColourSource=list_2, ObjectColour=gradient, maintainBakeName=False)

boundary = BoundarySurfaces(Edges=crv_2)
srf = Surface(boundary)

area = Area(Geometry=srf)  # -> Area, Centroid

building_centroid = Point(area.Centroid)

end = EndPoints(Curve=acces)  # -> Start, End
incurve = PointInCurve(Point=end.Start, Curve=graft(srf))  # -> Relationship, Point
incurve_2 = PointInCurve(Point=end.End, Curve=graft(srf))  # -> Relationship, Point
equals = Equality(FirstNumber=incurve_2.Relationship, SecondNumber="0")  # -> Equality, Inequality
equals_2 = Equality(FirstNumber=incurve.Relationship, SecondNumber="0")  # -> Equality, Inequality
not = GateNot(A=equals_2.Equality)
not_2 = GateNot(A=equals.Equality)
cull = CullPattern(List=end.Start, CullPattern=not_2)
cull_2 = CullPattern(List=end.End, CullPattern=not)
merge_3 = Merge(Data1=simplify(cull_2), Data2=simplify(cull))
null = NullItem(Item=merge_3)  # -> NullFlags, InvalidFlags, Description
weave = Weave(Pattern=null.NullFlags, Stream0=merge_3, Stream1=graft(building_centroid), NullGaps=False)  # -> flatten(Weave)

# ---- group: Sort buildings to the closest street segment
crv_cp = CurveClosestPoint(Point=simplify(graft(weave)), Curve=simplify(crv))  # -> Point, Parameter, Distance
lng = ListLength(List=crv)
series = Series(Start=0, Step=1, Count=lng)
sort = SortList(Keys=crv_cp.Distance, ValuesA=series)  # -> Keys, ValuesA
graft = GraftTree(Tree=series, IncludeEmptyLists=True, IncludeNullItems=True)  # -> simplify(Tree)
item = ListItem(List=sort.ValuesA, Index=0, Wrap=True)  # -> simplify(flatten(Item)), Item1, Item2
c_script = CSharpScript(x=item.Item, y=graft)  # -> out, A; inputs x: list of Int32, y: tree of Int32
# ---------- c_script: C# ----------
    DataTree<int> Out = new DataTree<int>();
    for(int i = 0; i < y.BranchCount; i++)
    {
      Out.EnsurePath(y.Paths[i]);
    }

    for(int i = 0; i < x.Count; i++)
    {
      Out.Add(i, new GH_Path(x[i]));
    }

    A = Out;
# ---------- end c_script ----------

# ----
item_2 = ListItem(List=crv_cp.Point, Index=graft(item.Item), Wrap=True)
ln = Line(StartPoint=graft(weave), EndPoint=item_2)

# ---- group: Visualize the plots based on the network centrality
item_3 = ListItem(List=_4_f_w_get_paths.ClosenessCentrality, Index=item.Item, Wrap=True)  # -> flatten(Item)
num = Number(item_3)
bnd_2 = Bounds(Numbers=num)
remap = RemapNumbers(Value=num, Source=bnd_2, Target=Domain(0, 1))  # -> Mapped, Clipped
gradient_2 = Gradient(LowerLimit=0, UpperLimit=1, Parameter=remap.Mapped, stops=[0: RGB(0, 128, 0), 0.5: RGB(255, 255, 0), 1: RGB(255, 0, 0)])

# ----
hatch_2 = DefineHatch(Curve=flatten(srf), Pattern="Solid", Rotation=0, Scale=1)
short = ShortestList(ListA=hatch_2, ListB=gradient_2, ListC=num, TrimMode=2)  # -> ListA, ListB, ListC

lng_2 = ListLength(List=short.ListB)
dup = DuplicateData(Data="centralitate_accesibilitate", Number=lng_2, Order=True)

attributes_2 = EleFrontAttributes(Keys=dup, Values=short.ListC, Layer=ef_layer, ColourSource=list, ObjectColour=short.ListB, maintainBakeName=False)

bbox = BoundingBox(Content=limita_analiza, Plane=PlaneXY(0, 0, 0))  # -> Box, Box_2
evalsrf = EvaluateSurface(Surface=reparameterize(bbox.Box), Point="{1,0,0}")  # -> Point, Normal, UDirection, VDirection, Frame
Y = UnitY(Factor="-100")
list_3 = ValueList({"Default", "Legenda", "Legenda_numere"}, selected="Legenda")
move = Move(Geometry=evalsrf.Point, Motion=Y)  # -> Geometry, Transform
range = Range(Domain=bnd_2, Steps=expr("x-1", "5"))
range_2 = Range(Domain=Domain(0, 1), Steps=expr("x-1", "5"))
sqgrid = Square(Plane=move.Geometry, Size=Slider(50, range=0..100), ExtentX="5", ExtentY="1")  # -> Cells, Points
text = DefineTextObject(Text="analiza_centralitate", Plane=evalsrf.Point, DimensionStyle=list_3)
swatch = ColourSwatch(SwatchColor=RGB(0, 0, 0))
hatch_3 = DefineHatch(Curve=flatten(sqgrid.Cells), Pattern="Solid", Rotation=0, Scale=1)
area_2 = Area(Geometry=flatten(sqgrid.Cells))  # -> Area, Centroid
gradient_3 = Gradient(LowerLimit=0, UpperLimit=1, Parameter=range_2, stops=[0: RGB(0, 128, 0), 0.5: RGB(255, 255, 0), 1: RGB(255, 0, 0)])
expression = Expression(x=range, y=Slider(2, range=0..10), Expression="Round(x,y)")
concat_4 = Concatenate(FragmentA=concat, FragmentB="::legenda")
Y_2 = UnitY(Factor="-30")
list_4 = ValueList({"Default", "Legenda", "Legenda_numere"}, selected="Legenda_numere")
ef_layer_3 = EleFrontLayer(Layer=concat_4, fullpath=True)
move_2 = Move(Geometry=area_2.Centroid, Motion=Y_2)  # -> Geometry, Transform
text_2 = DefineTextObject(Text=expression, Plane=move_2.Geometry, DimensionStyle=list_4)
list_5 = ValueList({"Layer", "Material", "Object", "Parent"}, selected="Object")
list_6 = ValueList({"Layer", "Material", "Object", "Parent"}, selected="Object")
lng_3 = ListLength(List=text_2)
attributes_3 = EleFrontAttributes(Layer=ef_layer_3, ColourSource=list_6, ObjectColour=gradient_3, maintainBakeName=False)
attributes_4 = EleFrontAttributes(Layer=ef_layer_3, ColourSource=list_5, ObjectColour=swatch, maintainBakeName=False)
list_7 = ValueList({"Layer", "Material", "Object", "Parent"}, selected="Object")
dup_2 = DuplicateData(Data=swatch, Number=lng_3, Order=True)
attributes_5 = EleFrontAttributes(Layer=ef_layer_3, ColourSource=list_7, ObjectColour=dup_2, maintainBakeName=False)
merge_4 = Merge(Data1=flatten(short.ListA), Data2=flatten(hatch), Data3=flatten(text), Data4=flatten(hatch_3), Data5=flatten(text_2))
merge_5 = Merge(
    Data1=flatten(attributes_2),
    Data2=flatten(attributes),
    Data3=flatten(attributes_4),
    Data4=flatten(attributes_3),
    Data5=flatten(attributes_5))

deatt = EleFrontAttributes(Attributes=merge_5, maintainBakeName=False)
bake = BakeObjects(Geometry=merge_4, Attributes=merge_5, Bake=button, createGroups=False)  # -> Message, Ghosts

material = CreateMaterial(Diffuse=deatt, Specular=RGB(255, 255, 255), Emission=RGB(0, 0, 0), Transparency=0, Shine=0)
preview = CustomPreview(Geometry=merge_4, Shader=flatten(material))
