# Grasshopper definition 02_analiza_vizibilitate_punct_2025.gh (Grasshopper 1.0.8)
# plug-ins: DeCodingSpaces, eleFront

# ----
# Analiză vizibilitate într-un singur punct
# 
# Analiza vizibilitate în plan
# dintr-un singur punct fix.
# 
# Script dezvoltat în cadrul proiectului
# SCHOLAR ARCHITECT 2024
# Proiect finațat prin CNFIS-FDI-2024-F-0032.
# Autori: Ionuț Anton și Ana Daniela Anton
pipeline = GeometryPipeline(
    GroupByLayer=False,
    GroupByType=False,
    IncludeHidden=True,
    IncludeLocked=True,
    LayerFilter="propunere::Constructii",
    NameFilter="*",
    SublayerFiltering=True,
    TypeFilter=4)
pipeline_2 = GeometryPipeline(
    GroupByLayer=False,
    GroupByType=False,
    IncludeHidden=True,
    IncludeLocked=True,
    LayerFilter="urbanism::Constructii",
    NameFilter="*",
    SublayerFiltering=True,
    TypeFilter=4)
pipeline_3 = GeometryPipeline(
    GroupByLayer=False,
    GroupByType=False,
    IncludeHidden=True,
    IncludeLocked=True,
    LayerFilter="analiza::contur limita analiza",
    NameFilter="*",
    SublayerFiltering=True,
    TypeFilter=4)
pipeline_4 = GeometryPipeline(
    GroupByLayer=False,
    GroupByType=False,
    IncludeHidden=True,
    IncludeLocked=True,
    LayerFilter="analiza::vizibilitate::punct",
    NameFilter="*",
    SublayerFiltering=True,
    TypeFilter=1)

# ---- group: Click aici pentru bake in rhino
button = Button()

# ----
contur_limita_analiza = Curve(pipeline_3)
punct_vizibilitate = Point(pipeline_4)
propunere = Curve(pipeline)
constructii = Curve(pipeline_2)
merge = Merge(Data1=constructii, Data2=contur_limita_analiza, Data3=propunere)
explode = Explode(Curve=merge, Recursive=True)  # -> flatten(Segments), Vertices
isovist = Isovist(
    VantagePointS=punct_vizibilitate,
    ObstacleLines=explode.Segments,
    ViewingDirection=Vector(0, 1, 0),
    ViewingRange=1000,
    ViewingAngle=360,
    Precision=360,
    ShowPolygon=True,
    ShowRadials=Toggle(True),
    UseGPU=Toggle(True))  # -> IsovistPolygon, Radials, ObstacleVisibility, IsovistProperties
equals = Equality(FirstNumber="0", SecondNumber=isovist.ObstacleVisibility)  # -> Equality, Inequality
hatch = DefineHatch(Curve=constructii, Pattern="Solid", Rotation=0, Scale=1)  # -> flatten(Hatch)
not = GateNot(A=equals.Equality)
cull = CullPattern(List=explode.Segments, CullPattern=not)
dehatch = DeconstructHatch(Hatch=hatch)  # -> flatten(HatchGeometry), flatten(Boundary), Name, Scale, Rotation
midpt = CurveMiddle(Curve=cull)
hatch_2 = DefineHatch(Curve=isovist.IsovistPolygon, Pattern="Solid", Rotation=0, Scale=1)
lng = ListLength(List=dehatch.HatchGeometry)
incurves = PointInCurves(Point=midpt, Curves=dehatch.HatchGeometry)  # -> Relationship, Index, Point
series = Series(Start=0, Step=1, Count=lng)
cset = CreateSet(List=incurves.Index)  # -> Set, Map
cull_i = CullIndex(List=series, Indices=cset.Set, Wrap=True)
item = ListItem(List=dehatch.HatchGeometry, Index=cset.Set, Wrap=False)
item_2 = ListItem(List=dehatch.HatchGeometry, Index=cset.Set, Wrap=False)
item_3 = ListItem(List=dehatch.HatchGeometry, Index=cull_i, Wrap=False)
area = Area(Geometry=item)  # -> Area, Centroid
dist = Distance(PointA=area.Centroid, PointB=punct_vizibilitate)
bnd = Bounds(Numbers=dist)
remap = RemapNumbers(Value=dist, Source=bnd, Target=Domain(0, 1))  # -> Mapped, Clipped
gradient = Gradient(
    LowerLimit=0,
    UpperLimit=1,
    Parameter=remap.Mapped,
    stops=[0: RGB(255, 0, 0), 0.5: RGB(255, 136, 0), 1: RGB(255, 247, 0)])
cir = Circle(Plane=punct_vizibilitate, Radius=Slider(2.5, range=0..10))
hatch_3 = DefineHatch(Curve=cir, Pattern="Solid", Rotation=0, Scale=1)

trigger = Trigger(Interval=60000, TimerInterval=60000, Target=time)
time = Time("now")
format = Format(Format="{0:yyyy-MM-dd-HH-mm-ss}", Culture=127, Data0=time)
concat = Concatenate(FragmentA="analiza_out::vizibilitate_punct::", FragmentB=format)
concat_2 = Concatenate(FragmentA=concat, FragmentB="::analiza")

lng_2 = ListLength(List=item_3)
lng_3 = ListLength(List=hatch_2)
dup = DuplicateData(Data=ColourSwatch(SwatchColor=RGB(133, 133, 133)), Number=lng_2, Order=True)
dup_2 = DuplicateData(Data=ColourSwatch(SwatchColor=RGB(0, 98, 255)), Number=lng_3, Order=True)
ef_layer = EleFrontLayer(Layer=concat_2, fullpath=True)
merge_2 = Merge(
    Data1=flatten(dup),
    Data2=flatten(dup_2),
    Data3=flatten(gradient),
    Data4=flatten(ColourSwatch(SwatchColor=RGB(255, 255, 255))))
merge_3 = Merge(Data1=flatten(item_3), Data2=flatten(hatch_2), Data3=flatten(item_2), Data4=flatten(hatch_3))

list = ValueList({"Layer", "Material", "Object", "Parent"}, selected="Object")
attributes = EleFrontAttributes(Layer=ef_layer, ColourSource=list, ObjectColour=merge_2, maintainBakeName=False)

bbox = BoundingBox(Content=contur_limita_analiza, Plane=PlaneXY(0, 0, 0))  # -> Box, Box_2
evalsrf = EvaluateSurface(Surface=reparameterize(bbox.Box), Point="{1,0,0}")  # -> Point, Normal, UDirection, VDirection, Frame
Y = UnitY(Factor="-100")
list_2 = ValueList({"Default", "Legenda", "Legenda_numere"}, selected="Legenda")
move = Move(Geometry=evalsrf.Point, Motion=Y)  # -> Geometry, Transform
range = Range(Domain=bnd, Steps=expr("x-1", "5"))
range_2 = Range(Domain=Domain(0, 1), Steps=expr("x-1", "5"))
sqgrid = Square(Plane=move.Geometry, Size=Slider(50, range=0..100), ExtentX="5", ExtentY="1")  # -> Cells, Points
text = DefineTextObject(Text="vizibilitate_punct", Plane=evalsrf.Point, DimensionStyle=list_2)
swatch = ColourSwatch(SwatchColor=RGB(0, 0, 0))
area_2 = Area(Geometry=flatten(sqgrid.Cells))  # -> Area, Centroid
round = Round(Number=range)  # -> Nearest, Floor, Ceiling
concat_3 = Concatenate(FragmentA=concat, FragmentB="::legenda")
Y_2 = UnitY(Factor="-30")
hatch_4 = DefineHatch(Curve=sqgrid.Cells, Pattern="Solid", Rotation=0, Scale=1)
gradient_2 = Gradient(LowerLimit=0, UpperLimit=1, Parameter=range_2, stops=[0: RGB(255, 0, 0), 0.5: RGB(255, 136, 0), 1: RGB(255, 247, 0)])
list_3 = ValueList({"Default", "Legenda", "Legenda_numere"}, selected="Legenda_numere")
ef_layer_2 = EleFrontLayer(Layer=concat_3, fullpath=True)
move_2 = Move(Geometry=area_2.Centroid, Motion=Y_2)  # -> Geometry, Transform
text_2 = DefineTextObject(Text=round.Nearest, Plane=move_2.Geometry, DimensionStyle=list_3)
lng_4 = ListLength(List=text_2)
dup_3 = DuplicateData(Data=swatch, Number=lng_4, Order=True)
list_4 = ValueList({"Layer", "Material", "Object", "Parent"}, selected="Object")
list_5 = ValueList({"Layer", "Material", "Object", "Parent"}, selected="Object")
list_6 = ValueList({"Layer", "Material", "Object", "Parent"}, selected="Object")
attributes_2 = EleFrontAttributes(Layer=ef_layer_2, ColourSource=list_6, ObjectColour=gradient_2, maintainBakeName=False)
attributes_3 = EleFrontAttributes(Layer=ef_layer_2, ColourSource=list_5, ObjectColour=swatch, maintainBakeName=False)
attributes_4 = EleFrontAttributes(Layer=ef_layer_2, ColourSource=list_4, ObjectColour=dup_3, maintainBakeName=False)
merge_4 = Merge(Data1=flatten(attributes), Data2=flatten(attributes_3), Data3=flatten(attributes_4), Data4=flatten(attributes_2))
merge_5 = Merge(Data1=flatten(merge_3), Data2=flatten(text), Data3=flatten(text_2), Data4=flatten(hatch_4))

deatt = EleFrontAttributes(Attributes=merge_4, maintainBakeName=False)
bake = BakeObjects(Geometry=merge_5, Attributes=merge_4, Bake=button, createGroups=False)  # -> Message, Ghosts

material = CreateMaterial(Diffuse=deatt, Specular=RGB(255, 255, 255), Emission=RGB(0, 0, 0), Transparency=0, Shine=0)
preview = CustomPreview(Geometry=merge_5, Shader=flatten(material))
