# Grasshopper definition 04_analiza_vizibilitate_zona_2025.gh (Grasshopper 1.0.8)
# plug-ins: DeCodingSpaces, eleFront

# ---- group: Număr secțiuni pe curbă
number_slider = Slider(35, range=0..100)

# ---- group: Click aici pentru bake in rhino
button = Button()

# ----
# Analiză vizibilitate pe o zonă
# 
# Analiza vizibilitate în plan
# pe o zona determinată de o curbă.
# Generare secțiuni la spații egale pe curbă
# 
# Script dezvoltat în cadrul proiectului
# SCHOLAR ARCHITECT 2024
# Proiect finațat prin CNFIS-FDI-2024-F-0032.
# Autori: Ionuț Anton și Ana Daniela Anton
pipeline = GeometryPipeline(
    GroupByLayer=False,
    GroupByType=False,
    IncludeHidden=True,
    IncludeLocked=True,
    LayerFilter="urbanism::Constructii",
    NameFilter="*",
    SublayerFiltering=True,
    TypeFilter=4)
pipeline_2 = GeometryPipeline(
    GroupByLayer=False,
    GroupByType=False,
    IncludeHidden=True,
    IncludeLocked=True,
    LayerFilter="analiza::contur limita analiza",
    NameFilter="*",
    SublayerFiltering=True,
    TypeFilter=4)
pipeline_3 = GeometryPipeline(
    GroupByLayer=False,
    GroupByType=False,
    IncludeHidden=True,
    IncludeLocked=True,
    LayerFilter="analiza::vizibilitate::curba",
    NameFilter="*",
    SublayerFiltering=True,
    TypeFilter=4)
pipeline_4 = GeometryPipeline(
    GroupByLayer=False,
    GroupByType=False,
    IncludeHidden=True,
    IncludeLocked=True,
    LayerFilter="urbanism::Insule",
    NameFilter="*",
    SublayerFiltering=True,
    TypeFilter=4)

crv = Curve(pipeline)
crv_2 = Curve(pipeline_2)
crv_3 = Curve(pipeline_3)
merge = Merge(Data1=crv, Data2=crv_2)
divide = DivideCurve(Curve=crv_3, Count=Slider(20, range=0..100), Kinks=False)  # -> Points, Tangents, Parameters
pt = Point(divide.Points)
explode = Explode(Curve=merge, Recursive=True)  # -> flatten(Segments), Vertices
isovist = Isovist(
    VantagePointS=pt,
    ObstacleLines=explode.Segments,
    ViewingDirection=Vector(0, 1, 0),
    ViewingRange=1000,
    ViewingAngle=360,
    Precision=360,
    ShowPolygon=True,
    ShowRadials=Toggle(False),
    UseGPU=Toggle(False))  # -> IsovistPolygon, Radials, ObstacleVisibility, IsovistProperties
equals = Equality(FirstNumber="0", SecondNumber=isovist.ObstacleVisibility)  # -> Equality, Inequality
not = GateNot(A=equals.Equality)
hatch = DefineHatch(Curve=crv, Pattern="Solid", Rotation=0, Scale=1)
cull = CullPattern(List=explode.Segments, CullPattern=not)
lng = ListLength(List=crv)
midpt = CurveMiddle(Curve=cull)
dehatch = DeconstructHatch(Hatch=hatch)  # -> flatten(HatchGeometry), Boundary, Name, Scale, Rotation
series = Series(Start=0, Step=1, Count=lng)
incurves = PointInCurves(Point=midpt, Curves=dehatch.HatchGeometry)  # -> Relationship, Index, Point
cset = CreateSet(List=flatten(incurves.Index))  # -> Set, Map
cull_i = CullIndex(List=series, Indices=cset.Set, Wrap=True)
item = ListItem(List=dehatch.HatchGeometry, Index=cset.Set, Wrap=False)
item_2 = ListItem(List=hatch, Index=cull_i, Wrap=False)
item_3 = ListItem(List=hatch, Index=cset.Set, Wrap=False)
area = Area(Geometry=item)  # -> Area, Centroid
runion = RegionUnion(Curves=isovist.IsovistPolygon)
cp = ClosestPoint(Point=area.Centroid, Cloud=pt)  # -> ClosestPoint, CPIndex, Distance
hatch_2 = DefineHatch(Curve=runion, Pattern="Solid", Rotation=0, Scale=1)
bnd = Bounds(Numbers=cp.Distance)
remap = RemapNumbers(Value=cp.Distance, Source=bnd, Target=Domain(0, 1))  # -> Mapped, Clipped
gradient = Gradient(
    LowerLimit=0,
    UpperLimit=1,
    Parameter=remap.Mapped,
    stops=[0: RGB(255, 0, 0), 0.5: RGB(255, 136, 0), 1: RGB(255, 247, 0)])

insule = Data(graft(pipeline_4))
list = ValueList({"inaltime(m)"}, selected="inaltime(m)")
data = Data(graft(crv))
getuv = GetUserValue(Geometry=data, Key=list, detectGeometry=False)  # -> simplify(InaltimeM)
boundary = BoundarySurfaces(Edges=data)
boundary_2 = BoundarySurfaces(Edges=insule)
pframes = PerpFrames(Curve=crv_3, Count=number_slider, Align=True)  # -> Frames, Parameters
number_slider_2 = Slider(20, range=0..100)
deplane = DeconstructPlane(Plane=pframes.Frames)  # -> Origin, XAxis, YAxis, ZAxis
lng_2 = ListLength(List=pframes.Frames)
dup = DuplicateData(Data=getuv, Number=lng_2, Order=True)  # -> simplify(Data)
line = LineSDL(Start=deplane.Origin, Direction=expr("-x", deplane.XAxis), Length=number_slider_2)
line_2 = LineSDL(Start=deplane.Origin, Direction=deplane.XAxis, Length=number_slider_2)
flip = FlipMatrix(Data=dup)
join = JoinCurves(Curves=[line_2, line], Preserve=False)
scx = SurfaceCurve(Surface=simplify(flatten(boundary_2)), Curve=graft(join))  # -> simplify(Curves), Points, UVPoints, Normals, Parameters, Tangents
scx_2 = SurfaceCurve(Surface=simplify(flatten(boundary)), Curve=graft(join))  # -> simplify(Curves), Points, UVPoints, Normals, Parameters, Tangents
null = NullItem(Item=scx.Curves)  # -> NullFlags, InvalidFlags, Description
null_2 = NullItem(Item=scx_2.Curves)  # -> NullFlags, InvalidFlags, Description
pshift = ShiftPaths(Data=null.NullFlags, Offset=-1)
pshift_2 = ShiftPaths(Data=null_2.NullFlags, Offset=-1)
amp = Amplitude(Vector=graft(deplane.ZAxis), Amplitude=expr("-x", Slider(0.15, range=0..1)))
not_2 = GateNot(A=pshift_2)
pshift_3 = ShiftPaths(Data=scx.Curves, Offset=-1)
pshift_4 = ShiftPaths(Data=scx_2.Curves, Offset=-1)
cull_2 = CullPattern(List=flip, CullPattern=not_2)
move = Move(Geometry=join, Motion=amp)  # -> Geometry, Transform
move_2 = Move(Geometry=move.Geometry, Motion=amp)  # -> Geometry, Transform
amp_2 = Amplitude(Vector=graft(deplane.ZAxis), Amplitude=expr("-x", Slider(0.15, range=0..1)))
amp_3 = Amplitude(Vector=graft(deplane.ZAxis), Amplitude=cull_2)
clean = CleanTree(RemoveNulls=True, RemoveInvalid=True, RemoveEmpty=False, Tree=amp_2)
clean_2 = CleanTree(RemoveNulls=True, RemoveInvalid=True, RemoveEmpty=False, Tree=amp_3)
move_3 = Move(Geometry=pshift_3, Motion=simplify(clean))  # -> Geometry, Transform
move_4 = Move(Geometry=pshift_4, Motion=clean_2)  # -> Geometry, Transform
merge_2 = Merge(Data1=simplify(graft(pshift_3)), Data2=simplify(graft(move_3.Geometry)))
merge_3 = Merge(Data1=simplify(graft(move_2.Geometry)), Data2=simplify(graft(move.Geometry)))
merge_4 = Merge(Data1=simplify(graft(pshift_4)), Data2=simplify(graft(move_4.Geometry)))
loft = Loft(Curves=merge_2, Options={Adjust=False, Closed=False, LoftEnds=0, LoftSimp=0, LoftType=0, Rebuild=10, Refit=0.01})
loft_2 = Loft(Curves=merge_4, Options={Adjust=False, Closed=False, LoftEnds=0, LoftSimp=0, LoftType=0, Rebuild=10, Refit=0.01})
loft_3 = Loft(Curves=merge_3, Options={Adjust=False, Closed=False, LoftEnds=0, LoftSimp=0, LoftType=0, Rebuild=10, Refit=0.01})
merge_5 = Merge(Data1=simplify(loft_3), Data2=simplify(loft_2), Data3=simplify(loft))
wires = BrepWireframe(Brep=merge_5, Density=-1)
join_2 = JoinCurves(Curves=wires, Preserve=False)  # -> simplify(Curves)
pshift_5 = ShiftPaths(Data=join_2, Offset=-1)
pshift_6 = ShiftPaths(Data=pshift_5, Offset=-1)
hatch_3 = DefineHatch(Curve=pshift_6, Pattern="Solid", Rotation=0, Scale=1)  # -> flatten(Hatch)
Z = UnitZ(Factor="0.05")
lng_3 = ListLength(List=hatch_3)
move_5 = Move(Geometry=hatch_3, Motion=Z)  # -> Geometry, Transform
dup_2 = DuplicateData(Data=ColourSwatch(SwatchColor=RGB(255, 255, 255)), Number=lng_3, Order=True)

trigger = Trigger(Interval=60000, TimerInterval=60000, Target=time)
time = Time("now")
format = Format(Format="{0:yyyy-MM-dd-HH-mm-ss}", Culture=127, Data0=time)
concat = Concatenate(FragmentA="analiza_out::vizibilitate_zona::", FragmentB=format)
concat_2 = Concatenate(FragmentA=concat, FragmentB="::sectiuni")

lng_4 = ListLength(List=item_2)
lng_5 = ListLength(List=hatch_2)
dup_3 = DuplicateData(Data=ColourSwatch(SwatchColor=RGB(112, 112, 112)), Number=lng_4, Order=True)
dup_4 = DuplicateData(Data=ColourSwatch(SwatchColor=RGB(0, 98, 255)), Number=lng_5, Order=True)
concat_3 = Concatenate(FragmentA=concat, FragmentB="::rezultate")
list_2 = ValueList({"Layer", "Material", "Object", "Parent"}, selected="Object")
ef_layer = EleFrontLayer(Layer=concat_3, fullpath=True)
list_3 = ValueList({"Layer", "Material", "Object", "Parent"}, selected="Object")
merge_6 = Merge(Data1=flatten(dup_3), Data2=flatten(dup_4), Data3=flatten(gradient))
ef_layer_2 = EleFrontLayer(Layer=concat_2, fullpath=True)
merge_7 = Merge(Data1=flatten(item_2), Data2=flatten(hatch_2), Data3=flatten(item_3), Data4=move_5.Geometry)
attributes = EleFrontAttributes(Layer=ef_layer_2, ColourSource=list_3, ObjectColour=dup_2, maintainBakeName=False)
attributes_2 = EleFrontAttributes(Layer=ef_layer, ColourSource=list_2, ObjectColour=merge_6, maintainBakeName=False)
merge_8 = Merge(Data1=flatten(attributes_2), Data2=flatten(attributes))

bbox = BoundingBox(Content=crv_2, Plane=PlaneXY(0, 0, 0))  # -> Box, Box_2
evalsrf = EvaluateSurface(Surface=reparameterize(bbox.Box), Point="{1,0,0}")  # -> Point, Normal, UDirection, VDirection, Frame
Y = UnitY(Factor="-100")
list_4 = ValueList({"Default", "Legenda", "Legenda_numere"}, selected="Legenda")
move_6 = Move(Geometry=evalsrf.Point, Motion=Y)  # -> Geometry, Transform
range = Range(Domain=bnd, Steps=expr("x-1", "5"))
range_2 = Range(Domain=Domain(0, 1), Steps=expr("x-1", "5"))
sqgrid = Square(Plane=move_6.Geometry, Size=Slider(50, range=0..100), ExtentX="5", ExtentY="1")  # -> Cells, Points
text = DefineTextObject(Text="vizibilitate_zona", Plane=evalsrf.Point, DimensionStyle=list_4)
gradient_2 = Gradient(LowerLimit=0, UpperLimit=1, Parameter=range_2, stops=[0: RGB(255, 0, 0), 0.5: RGB(255, 136, 0), 1: RGB(255, 247, 0)])
area_2 = Area(Geometry=flatten(sqgrid.Cells))  # -> Area, Centroid
hatch_4 = DefineHatch(Curve=flatten(sqgrid.Cells), Pattern="Solid", Rotation=0, Scale=1)
swatch = ColourSwatch(SwatchColor=RGB(0, 0, 0))
Y_2 = UnitY(Factor="-30")
concat_4 = Concatenate(FragmentA=concat, FragmentB="::legenda")
expression = Expression(x=range, y=Slider(2, range=0..10), Expression="Round(x,y)")
list_5 = ValueList({"Default", "Legenda", "Legenda_numere"}, selected="Legenda_numere")
move_7 = Move(Geometry=area_2.Centroid, Motion=Y_2)  # -> Geometry, Transform
ef_layer_3 = EleFrontLayer(Layer=concat_4, fullpath=True)
text_2 = DefineTextObject(Text=expression, Plane=move_7.Geometry, DimensionStyle=list_5)
lng_6 = ListLength(List=text_2)
list_6 = ValueList({"Layer", "Material", "Object", "Parent"}, selected="Object")
list_7 = ValueList({"Layer", "Material", "Object", "Parent"}, selected="Object")
dup_5 = DuplicateData(Data=swatch, Number=lng_6, Order=True)
list_8 = ValueList({"Layer", "Material", "Object", "Parent"}, selected="Object")
attributes_3 = EleFrontAttributes(Layer=ef_layer_3, ColourSource=list_7, ObjectColour=swatch, maintainBakeName=False)
attributes_4 = EleFrontAttributes(Layer=ef_layer_3, ColourSource=list_8, ObjectColour=gradient_2, maintainBakeName=False)
attributes_5 = EleFrontAttributes(Layer=ef_layer_3, ColourSource=list_6, ObjectColour=dup_5, maintainBakeName=False)
merge_9 = Merge(Data1=flatten(merge_8), Data2=flatten(attributes_3), Data3=flatten(attributes_5), Data4=flatten(attributes_4))
merge_10 = Merge(Data1=flatten(merge_7), Data2=flatten(text), Data3=flatten(text_2), Data4=flatten(hatch_4))

deatt = EleFrontAttributes(Attributes=merge_9, maintainBakeName=False)
bake = BakeObjects(Geometry=merge_10, Attributes=merge_9, Bake=button, createGroups=False)  # -> Message, Ghosts

material = CreateMaterial(Diffuse=deatt, Specular=RGB(255, 255, 255), Emission=RGB(0, 0, 0), Transparency=0, Shine=0)
preview = CustomPreview(Geometry=merge_10, Shader=flatten(material))
