# Grasshopper definition 08_analiza_denisitate_zona_2025.gh (Grasshopper 1.0.7)
# plug-ins: EleFront

pipeline = GeometryPipeline(
    GroupByLayer=False,
    GroupByType=False,
    IncludeHidden=True,
    IncludeLocked=True,
    LayerFilter="analiza::contur limita analiza",
    NameFilter="*",
    SublayerFiltering=True,
    TypeFilter=4)
# Analiză densitate - zona
# 
# Analiza denistate urbană folosind
# un grid de analiza pe o zonă.
# 
# Script dezvoltat în cadrul proiectului
# SCHOLAR ARCHITECT 2024
# Proiect finațat prin CNFIS-FDI-2024-F-0032.
# Autori: Ionuț Anton și Ana Daniela Anton
pipeline_2 = GeometryPipeline(
    GroupByLayer=False,
    GroupByType=False,
    IncludeHidden=True,
    IncludeLocked=True,
    LayerFilter="urbanism::Constructii",
    NameFilter="*",
    SublayerFiltering=True,
    TypeFilter=4)

# ---- group: Click aici pentru bake in rhino
button = Button()

# ----
list = ValueList({"inaltime(m)"}, selected="inaltime(m)")
bbox = BoundingBox(Content=pipeline, Plane=PlaneXY(0, 0, 0))  # -> Box, Box_2
number_slider = Slider(10, range=0..100)
getuv = GetUserValue(Geometry=pipeline_2, Key=list)
area = Area(Geometry=pipeline_2)  # -> Area, Centroid
evalsrf = EvaluateSurface(Surface=bbox.Box, Point="0,0")  # -> Point, Normal, UDirection, VDirection, Frame
dim = Dimensions(Surface=bbox.Box)  # -> UDimension, VDimension
division = Division(A=getuv, B="3")
int = Integer(division)
division_2 = Division(A=dim.UDimension, B=number_slider)
division_3 = Division(A=dim.VDimension, B=number_slider)
multiplication = Multiplication(A=int, B=area.Area)
sqgrid = Square(Plane=evalsrf.Point, Size=number_slider, ExtentX=division_2, ExtentY=division_3)  # -> flatten(Cells), Points
adc = Data(multiplication)
area_2 = Area(Geometry=sqgrid.Cells)  # -> Area, Centroid
incurve = PointInCurve(Point=area_2.Centroid, Curve=pipeline)  # -> Relationship, Point
equals = Equality(FirstNumber=incurve.Relationship, SecondNumber="2")  # -> Equality, Inequality
cull = CullPattern(List=sqgrid.Cells, CullPattern=equals.Equality)
data = Data(flatten(cull))
area_3 = Area(Geometry=data)  # -> Area, graft(Centroid)
wires = BrepWireframe(Brep=data, Density=-1)  # disabled
dist = Distance(PointA=area.Centroid, PointB=area_3.Centroid)
join = JoinCurves(Curves=wires, Preserve=False)  # disabled
smaller = SmallerThan(FirstNumber=dist, SecondNumber=Slider(150, range=0..1000))  # -> SmallerThan, OrEqualTo
cull_2 = CullPattern(List=adc, CullPattern=smaller.SmallerThan)
ma = MassAddition(Input=cull_2)  # -> flatten(Result), PartialResults
bnd = Bounds(Numbers=ma.Result)
dedomain = DeconstructDomain(Domain=bnd)  # -> Start, End
gradient = Gradient(
    LowerLimit=dedomain.Start,
    UpperLimit=dedomain.End,
    Parameter=ma.Result,
    stops=[0: RGB(0, 128, 0), 0.5: RGB(255, 255, 0), 1: RGB(255, 0, 0)])
hatch = DefineHatch(Curve=join, Pattern="Solid", Rotation=0, Scale=1)  # -> flatten(Hatch); disabled

preview = CustomPreview(Geometry=data, Material=gradient)
lng = ListLength(List=ma.Result)  # disabled
panel = Panel("::analiza")  # disabled

bbox_2 = BoundingBox(Content=pipeline, Plane=PlaneXY(0, 0, 0))  # -> Box, Box_2; disabled
panel_2 = Panel("{1,0,0}")  # disabled
panel_3 = Panel("densitate_zona")  # disabled
evalsrf_2 = EvaluateSurface(Surface=reparameterize(bbox_2.Box), Point=panel_2)  # -> Point, Normal, UDirection, VDirection, Frame; disabled
panel_4 = Panel("-100")  # disabled
Y = UnitY(Factor=panel_4)  # disabled
number_slider_2 = Slider(50, range=0..100)  # disabled
move = Move(Geometry=evalsrf_2.Point, Motion=Y)  # -> Geometry, Transform; disabled
panel_5 = Panel("5")  # disabled
panel_6 = Panel("1")  # disabled
list_2 = ValueList({"Default", "Legenda"}, selected="Legenda")  # disabled
number_slider_3 = Slider(0, range=0..10)  # disabled
range = Range(Domain=bnd, Steps=expr("x-1", panel_5))  # disabled
range_2 = Range(Domain=Domain(0, 1), Steps=expr("x-1", panel_5))  # disabled
sqgrid_2 = Square(Plane=move.Geometry, Size=number_slider_2, ExtentX=panel_5, ExtentY=panel_6)  # -> Cells, Points; disabled
text = DefineTextObject(Text=panel_3, Plane=evalsrf_2.Point, DimensionStyle=list_2, OutputType="Text")  # disabled
panel_7 = Panel("::legenda")  # disabled
hatch_2 = DefineHatch(Curve=flatten(sqgrid_2.Cells), Pattern="Solid", Rotation=0, Scale=1)  # disabled
gradient_2 = Gradient(LowerLimit=0, UpperLimit=1, Parameter=range_2, stops=[0: RGB(0, 128, 0), 0.5: RGB(255, 255, 0), 1: RGB(255, 0, 0)])  # disabled
area_4 = Area(Geometry=flatten(sqgrid_2.Cells))  # -> Area, Centroid; disabled
swatch = ColourSwatch(SwatchColor=RGB(0, 0, 0))  # disabled
panel_8 = Panel("-30")  # disabled
Y_2 = UnitY(Factor=panel_8)  # disabled
expression = Expression(x=range, y=number_slider_3, Expression="Round(x,y)")  # disabled
move_2 = Move(Geometry=area_4.Centroid, Motion=Y_2)  # -> Geometry, Transform; disabled
text_2 = DefineTextObject(Text=expression, Plane=move_2.Geometry, DimensionStyle="Legenda_numere", OutputType="Text")  # disabled
lng_2 = ListLength(List=text_2)  # disabled
dup = DuplicateData(Data=swatch, Number=lng_2, Order=True)  # disabled
merge = Merge(Data1=flatten(hatch), Data2=flatten(text), Data3=flatten(text_2), Data4=flatten(hatch_2))  # disabled

dup_2 = DuplicateData(Data=panel_3, Number=lng, Order=True)  # disabled

panel_9 = Panel("analiza_out::denistate_construit::")  # disabled
panel_10 = Panel("{0:yyyy-MM-dd-HH-mm-ss}")  # disabled
trigger = Trigger(Interval=60000, TimerInterval=60000, Target=time)  # disabled
panel_11 = Panel("now")  # disabled
time = Time(panel_11)  # disabled
format = Format(Format=panel_10, Culture=127, Data0=time)  # disabled
concat = Concatenate(FragmentA=panel_9, FragmentB=format)  # disabled

concat_2 = Concatenate(FragmentA=concat, FragmentB=panel)  # disabled

layer = DefineLayer(Name=concat_2)  # disabled

attributes = DefineObjectAttributes(UserKeys=dup_2, UserValues=ma.Result, Layer=layer, Color=gradient)  # disabled

concat_3 = Concatenate(FragmentA=concat, FragmentB=panel_7)  # disabled
layer_2 = DefineLayer(Name=concat_3)  # disabled
attributes_2 = DefineObjectAttributes(Layer=layer_2, Color=gradient_2)  # disabled
attributes_3 = DefineObjectAttributes(Layer=layer_2, Color=dup)  # disabled
attributes_4 = DefineObjectAttributes(Layer=layer_2, Color=swatch)  # disabled
merge_2 = Merge(Data1=flatten(attributes), Data2=flatten(attributes_4), Data3=flatten(attributes_3), Data4=flatten(attributes_2))  # disabled

deatt = DeconstructAttributes(ReferencedGeometryOrAttributes=merge_2)  # -> Keys, Values, Name, Layer, Color; disabled
bake = BakeObjects(Geometry=merge, Attributes=merge_2, Bake=button)  # disabled
material = CreateMaterial(Diffuse=deatt.Color, Specular=RGB(255, 255, 255), Emission=RGB(0, 0, 0), Transparency=0, Shine=0)  # disabled
preview_2 = CustomPreview(Geometry=merge, Shader=flatten(material))  # disabled
