# Grasshopper definition 09_analiza_radiatie_solara_2025.gh (Grasshopper 1.0.8)
# plug-ins: eleFront

# ---- group: marime grid analiza (recomandat 5)
number_slider = Slider(10, range=0..10)

# ----
pipeline = GeometryPipeline(
    GroupByLayer=False,
    GroupByType=False,
    IncludeHidden=True,
    IncludeLocked=True,
    LayerFilter="analiza::contur limita analiza",
    NameFilter="*",
    SublayerFiltering=True,
    TypeFilter=4)
pipeline_2 = GeometryPipeline(
    GroupByLayer=False,
    GroupByType=False,
    IncludeHidden=True,
    IncludeLocked=True,
    LayerFilter="propunere::Constructii",
    NameFilter="*",
    SublayerFiltering=True,
    TypeFilter=4)
pipeline_3 = GeometryPipeline(
    GroupByLayer=False,
    GroupByType=False,
    IncludeHidden=True,
    IncludeLocked=True,
    LayerFilter="urbanism::Constructii",
    NameFilter="*",
    SublayerFiltering=True,
    TypeFilter=4)

# ---- group: Click aici pentru bake in rhino
button = Button()

# ----
# Analiză radiatie solara
# 
# Analiza radiatie solara pe planul orizontal
# de-a lungul unui intreg an pentru Bucuresti.
# 
# Script dezvoltat în cadrul proiectului
# SCHOLAR ARCHITECT 2024
# Proiect finațat prin CNFIS-FDI-2024-F-0032.
# Autori: Ionuț Anton și Ana Daniela Anton
path = FilePath()

# ----
# Import Weather Data
python = GhPythonScript()  # -> out, a, b
# ---------- python: Python ----------
__author__ = "ionut"
__version__ = "2024.10.09"

import rhinoscriptsyntax as rs
import os

a = ghdoc.Path
# Get the directory of the given file path
folder_path = os.path.dirname(a)

# Define the subfolder and file to append
subfolder_file = r'..\installs\ROU_Bucharest.154200_IWEC\ROU_Bucharest.154200_IWEC.epw'

# Create the new file path by joining the folder path and subfolder_file
b = os.path.join(folder_path, subfolder_file)
# ---------- end python ----------
importepw = LBImportEPW(epw_file=python.b)  # -> location, dry_bulb_temperature, dew_point_temperature, relative_humidity, wind_speed, wind_direction, direct_normal_rad, diffuse_horizontal_rad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; plug-in component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

# ----
# Annual Radiation
panel = Panel("0")
skymatrix = LBCumulativeSkyMatrix(
    north=panel,
    location=importepw.location,
    direct_rad=importepw.direct_normal_rad,
    diffuse_rad=importepw.diffuse_horizontal_rad)  # -> report, sky_mtx; plug-in component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

# ---- group: Prima data click aici ca sa ruleze analiza
toggle = BooleanToggle(True)

# ----
time = Time("now")
format = Format(Format="{0:yyyy-MM-dd-HH-mm-ss}", Culture=127, Data0=time)
concat = Concatenate(FragmentA="analiza_out::radiatie_solara::", FragmentB=format)
concat_2 = Concatenate(FragmentA=concat, FragmentB="::cladiri_3d")

list = ValueList({"Layer", "Material", "Object", "Parent"}, selected="Object")
list_2 = ValueList({"Layer", "Material", "Object", "Parent"}, selected="Object")

merge = Merge(Data1=pipeline_2, Data2=pipeline_3)
getuv = GetUserValue(Geometry=merge, Key="inaltime(m)", detectGeometry=False)  # -> flatten(InaltimeM)
Z = UnitZ(Factor=getuv)
extr = Extrude(Base=merge, Direction=Z)
boundary = BoundarySurfaces(Edges=pipeline)
clean = CleanTree(RemoveNulls=True, RemoveInvalid=True, RemoveEmpty=False, Tree=extr)
cap = CapHoles(Brep=clean)
panel_2 = Panel(number_slider)

clean_2 = CleanTree(RemoveNulls=True, RemoveInvalid=True, RemoveEmpty=False, Tree=cap)

# ----
# Run Radiation Study
geo = Geometry(boundary)
geo_2 = Geometry(clean_2)
incidentradiation = LBIncidentRadiation(
    sky_mtx=skymatrix.sky_mtx,
    geometry=flatten(geo),
    context=flatten(geo_2),
    grid_size=panel_2,
    offset_dist="0.1",
    run=toggle)  # -> report, points, results, total, mesh, legend, title, int_mtx; plug-in component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

mesh = Mesh(incidentradiation.mesh)
bnd = Bounds(Numbers=flatten(incidentradiation.results))
dedomain = DeconstructDomain(Domain=bnd)  # -> Start, End
gradient = Gradient(
    LowerLimit=dedomain.Start,
    UpperLimit=dedomain.End,
    Parameter=incidentradiation.results,
    stops=[0: RGB(25, 0, 255), 0.5: RGB(255, 0, 0), 1: RGB(255, 255, 0)])
lng = ListLength(List=clean_2)
dup = DuplicateData(Data=ColourSwatch(SwatchColor=RGB(46, 46, 46)), Number=lng, Order=True)

bbox = BoundingBox(Content=pipeline, Plane=PlaneXY(0, 0, 0))  # -> Box, Box_2
evalsrf = EvaluateSurface(Surface=reparameterize(bbox.Box), Point="{1,0,0}")  # -> Point, Normal, UDirection, VDirection, Frame
Y = UnitY(Factor="-100")
list_3 = ValueList({"Default", "Legenda", "Legenda_numere"}, selected="Legenda")
move = Move(Geometry=evalsrf.Point, Motion=Y)  # -> Geometry, Transform
range = Range(Domain=bnd, Steps=expr("x-1", "5"))
range_2 = Range(Domain=Domain(0, 1), Steps=expr("x-1", "5"))
sqgrid = Square(Plane=move.Geometry, Size=Slider(50, range=0..100), ExtentX="5", ExtentY="1")  # -> Cells, Points
text = DefineTextObject(Text="radiatie_solara", Plane=evalsrf.Point, DimensionStyle=list_3)
hatch = DefineHatch(Curve=flatten(sqgrid.Cells), Pattern="Solid", Rotation=0, Scale=1)
area = Area(Geometry=flatten(sqgrid.Cells))  # -> Area, Centroid
swatch = ColourSwatch(SwatchColor=RGB(0, 0, 0))
Y_2 = UnitY(Factor="-30")
concat_3 = Concatenate(FragmentA=concat, FragmentB="::legenda")
expression = Expression(x=range, y=Slider(0, range=0..10), Expression="Round(x,y)")
gradient_2 = Gradient(LowerLimit=0, UpperLimit=1, Parameter=range_2, stops=[0: RGB(25, 0, 255), 0.5: RGB(255, 0, 0), 1: RGB(255, 255, 0)])
list_4 = ValueList({"Default", "Legenda", "Legenda_numere"}, selected="Legenda_numere")
move_2 = Move(Geometry=area.Centroid, Motion=Y_2)  # -> Geometry, Transform
layer = EleFrontLayer()
text_2 = DefineTextObject(Text=expression, Plane=move_2.Geometry, DimensionStyle=list_4)
lng_2 = ListLength(List=text_2)
list_5 = ValueList({"Layer", "Material", "Object", "Parent"}, selected="Object")
list_6 = ValueList({"Layer", "Material", "Object", "Parent"}, selected="Object")
dup_2 = DuplicateData(Data=swatch, Number=lng_2, Order=True)
list_7 = ValueList({"Layer", "Material", "Object", "Parent"}, selected="Object")
attributes = EleFrontAttributes(Layer=layer, ColourSource=list_7, ObjectColour=gradient_2, maintainBakeName=False)
attributes_2 = EleFrontAttributes(Layer=layer, ColourSource=list_6, ObjectColour=dup_2, maintainBakeName=False)
attributes_3 = EleFrontAttributes(Layer=layer, ColourSource=list_5, ObjectColour=swatch, maintainBakeName=False)

lng_3 = ListLength(List=incidentradiation.results)
dup_3 = DuplicateData(Data="radiatie_solara", Number=lng_3, Order=True)
concat_4 = Concatenate(FragmentA=concat, FragmentB="::analiza")
ef_layer = EleFrontLayer(Layer=concat_4, fullpath=True)
ef_layer_2 = EleFrontLayer(Layer=concat_2, fullpath=True)
merge_2 = Merge(Data1=flatten(mesh), Data2=flatten(clean_2))

attributes_4 = EleFrontAttributes(
    Keys=dup_3,
    Values=incidentradiation.results,
    Layer=ef_layer,
    ColourSource=list,
    ObjectColour=gradient,
    maintainBakeName=False)
attributes_5 = EleFrontAttributes(Layer=ef_layer_2, ColourSource=list_2, ObjectColour=dup, maintainBakeName=False)

merge_3 = Merge(Data1=flatten(attributes_4), Data2=flatten(attributes_5))

bake = BakeObjects(Geometry=merge_2, Attributes=merge_3, Bake=button, createGroups=False)  # -> Message, Ghosts

merge_4 = Merge(Data1=flatten(merge_3), Data2=flatten(attributes_3), Data3=flatten(attributes_2), Data4=flatten(attributes))
merge_5 = Merge(Data1=flatten(merge_2), Data2=flatten(text), Data3=flatten(text_2), Data4=flatten(hatch))

deatt = EleFrontAttributes(Attributes=merge_4, maintainBakeName=False)
bake_2 = BakeObjects(Geometry=merge_5, Attributes=merge_4, Bake=button, createGroups=False)  # -> Message, Ghosts

material = CreateMaterial(Diffuse=deatt, Specular=RGB(255, 255, 255), Emission=RGB(0, 0, 0), Transparency=0, Shine=0)
preview = CustomPreview(Geometry=merge_5, Shader=flatten(material))
